test file "TestFileTestcontrol"

suite "control"

  case "Test minDeg" [baseline]
    model privod, harness control_Harness1 (for privod/control)
    signal scenario: angleMIn (control_Harness1/Harness Inputs)
    assessment "TestCheck": At any point of time, forward must be greater than or equal to 1 and less than or equal to 1
    assessment "Assessment1": At any point of time, reverse must be greater than or equal to 0 and less than or equal to 0
      forward: signal control_Harness1/Output Conversion Subsystem, port 1
      reverse: signal control_Harness1/Output Conversion Subsystem, port 2

  case "Test maxMin Deg" [baseline]
    model privod, harness control_Harness1 (for privod/control)
    signal scenario: changeDeg (control_Harness1/Harness Inputs)
    assessment "Assessment1": At any point of time, forward must be greater than or equal to 0 and less than or equal to 1
    assessment "Assessment2": At any point of time, reverse must be greater than or equal to 0 and less than or equal to 1
      forward: signal control_Harness1/Output Conversion Subsystem, port 1
      reverse: signal control_Harness1/Output Conversion Subsystem, port 2